# Grasshopper definition intro_simple building.gh (Grasshopper 1.0.7)
# plug-ins: Bifocals

number_slider = Slider(0, range=0..100)

进深 = Slider(12.775, range=-10..100)
division = Division(A=进深, B="2")
negative = Negative(Value=division)
entwine = Entwine(Branch00=division, Branch01=negative, FlattenInputs=True)

curve = Curve(<curve referenced from the Rhino model>)
param_viewer = ParamViewer(curve)
evaluate_length = EvaluateLength(Curve=curve, Length=Slider(0.575, range=0..1), Normalized=Toggle(True))  # -> Point, Tangent, Parameter
进深_2 = Slider(18.516, range=-10..100)
line_sdl = LineSDL(Start=evaluate_length.Point, Direction=evaluate_length.Tangent, Length=Slider(44.073, range=0..100))
vector_display_ex = VectorDisplayEx(
    Point=evaluate_length.Point,
    Vector=evaluate_length.Tangent,
    Colour=ColourSwatch(SwatchColor=RGB(255, 66, 66)),
    Width=Slider(5.64, range=0..10))
vector_display = VectorDisplay(Anchor=evaluate_length.Point, Vector=evaluate_length.Tangent)
panel = Panel(line_sdl)
offset = Offset(Curve=line_sdl, Distance=entwine, Plane=PlaneXY(0, 0, 0), Corners=1)
panel_2 = Panel(evaluate_length.Parameter)
panel_3 = Panel(entwine)
end_points = EndPoints(Curve=offset)  # -> Start, End
divide_curve = DivideCurve(Curve=offset, Count=Slider(3, range=0..10), Kinks=False)  # -> Points, Tangents, Parameters
panel_4 = Panel(offset)
line_dimension = LineDimension(Line=offset, Text="{0:0.00}", Size=1)
entwine_2 = Entwine(Branch00=end_points.Start, Branch01=end_points.End, FlattenInputs=True)
panel_5 = Panel(end_points.Start)
panel_6 = Panel(end_points.End)
polyline = PolyLine(Vertices=entwine_2, Closed=False)
point = Point(end_points.Start)
panel_7 = Panel(entwine_2)
panel_8 = Panel(point)
explode_tree = ExplodeTree(Data=point)  # -> Branch0, Branch1
curve_2 = Curve(polyline)
line = Line(StartPoint=explode_tree.Branch0, EndPoint=explode_tree.Branch1)
panel_9 = Panel(curve_2)
panel_10 = Panel(polyline)
panel_11 = Panel(explode_tree.Branch1)
panel_12 = Panel(explode_tree.Branch0)
evaluate_length_2 = EvaluateLength(Curve=curve_2, Length=Slider(0.5, range=0..1), Normalized=True)  # -> Point, Tangent, Parameter
number_slider_2 = Slider(10, range=0..10)
panel_13 = Panel(evaluate_length_2.Point)

flatten_tree = FlattenTree(Tree=divide_curve.Points, Path="{0}")
list_item = ListItem(List=flatten_tree, Index=Slider(0, range=0..10), Wrap=True)
deconstruct = Deconstruct(Point=flatten_tree)  # -> XComponent, YComponent, ZComponent
graft_tree = GraftTree(Tree=flatten_tree, IncludeEmptyLists=True, IncludeNullItems=True)
deconstruct_2 = Deconstruct(Point=list_item)  # -> XComponent, YComponent, ZComponent
entwine_3 = Entwine(Branch00=deconstruct.XComponent, Branch01=deconstruct.YComponent, Branch02=deconstruct.ZComponent, FlattenInputs=True)
entwine_4 = Entwine(
    Branch00=deconstruct_2.XComponent,
    Branch01=deconstruct_2.YComponent,
    Branch02=deconstruct_2.ZComponent,
    FlattenInputs=True)
subtraction = Subtraction(A=entwine_3, B=entwine_4)
flip_matrix = FlipMatrix(Data=subtraction)
numbers_to_points = NumbersToPoints(Numbers=flip_matrix, Mask=4)
text_tag_3d = TextTag3D(Location=graft_tree, Text=numbers_to_points, Size=Slider(0.338, range=0..1), Justification=7)

unit_z = UnitZ(Factor=1)
addition = Addition(A=number_slider_2, B=Slider(3.2, range=0..10))

# ----
# 柱axis
point_2 = Point(divide_curve.Points)
unit_z_2 = UnitZ(Factor=1)
line_sdl_2 = LineSDL(Start=point_2, Direction=unit_z_2, Length=number_slider_2)
evaluate_length_3 = EvaluateLength(Curve=line_sdl_2, Length=Slider(1, range=0..1), Normalized=True)  # -> Point, Tangent, Parameter
pipe = Pipe(Curve=line_sdl_2, Radius=Slider(0.57, range=0..1), Caps=0)
polyline_2 = PolyLine(Vertices=evaluate_length_3.Point, Closed=False)
cap_holes = CapHoles(Brep=pipe)
end_points_2 = EndPoints(Curve=polyline_2)  # -> Start, End
flatten_tree_2 = FlattenTree(Tree=polyline_2, Path="{0}")
entwine_5 = Entwine(Branch00=end_points_2.Start, Branch01=end_points_2.End, FlattenInputs=True)
polyline_3 = PolyLine(Vertices=entwine_5, Closed=False)

param_viewer_2 = ParamViewer(point_2)
line_sdl_3 = LineSDL(Start=evaluate_length_2.Point, Direction=unit_z, Length=addition)
panel_14 = Panel(line_sdl_3)
panel_15 = Panel(point_2)
param_viewer_3 = ParamViewer(evaluate_length_3.Point)
evaluate_length_4 = EvaluateLength(Curve=line_sdl_3, Length=Slider(1, range=0..1), Normalized=True)  # -> flatten(Point), Tangent, Parameter
panel_16 = Panel(entwine_3)
panel_17 = Panel(evaluate_length_4.Point)
panel_18 = Panel(line_sdl_2)
aligned_dimension = AlignedDimension(Plane=PlaneXY(0, 0, 0), Offset=1, Text="{0:0.00}", Size=1)
polyline_4 = PolyLine(Vertices=evaluate_length_4.Point, Closed=False)
panel_19 = Panel(entwine_4)
simplify_curve = SimplifyCurve(Curve=polyline_2)  # -> Curve, Simplified
panel_20 = Panel(polyline_4)
panel_21 = Panel(flatten_tree_2)
panel_22 = Panel(subtraction)
control_points = ControlPoints(Curve=simplify_curve.Curve)  # -> Points, Weights, Knots
insert_items = InsertItems(List=flatten_tree_2, Item=polyline_4, Indices=expr("1", 1), Wrap=True)
panel_23 = Panel(flip_matrix)
panel_24 = Panel(insert_items)

number_slider_3 = Slider(2.425, range=0..10)
extend_curve = ExtendCurve(Curve=insert_items, Type=0, Start=number_slider_3, End=number_slider_3)
loft_options = LoftOptions(Closed=False, Adjust=False, Rebuild=0, Refit=0, Type=3)
simplify_curve_2 = SimplifyCurve(Curve=extend_curve)  # -> Curve, Simplified
control_points_2 = ControlPoints(Curve=simplify_curve_2.Curve)  # -> Points, Weights, Knots
polyline_5 = PolyLine(Vertices=control_points_2.Points, Closed=False)  # -> flatten(Polyline)
loft = Loft(Curves=polyline_5, Options=loft_options)

evaluate_length_5 = EvaluateLength(Curve=insert_items, Length=Slider(0.25, range=0..1), Normalized=True)  # -> Point, Tangent, Parameter

divide_curve_2 = DivideCurve(Curve=insert_items, Count=Slider(9, range=0..30), Kinks=False)  # -> Points, Tangents, Parameters
flip_matrix_2 = FlipMatrix(Data=divide_curve_2.Points)
number_slider_4 = Slider(3.083, range=0..10)
polyline_6 = PolyLine(Vertices=flip_matrix_2, Closed=False)
extend_curve_2 = ExtendCurve(Curve=polyline_6, Type=0, Start=number_slider_4, End=number_slider_4)  # -> flatten(Curve)
number_slider_5 = Slider(0.09, range=0..1)
number_slider_6 = Slider(0.192, range=0..1)
evaluate_length_6 = EvaluateLength(Curve=extend_curve_2, Length=Slider(0, range=0..1), Normalized=True)  # -> Point, Tangent, Parameter
construct_domain = ConstructDomain(DomainStart=number_slider_5, DomainEnd=expr("-x", number_slider_5))
construct_domain_2 = ConstructDomain(DomainStart=number_slider_6, DomainEnd=expr("-x", number_slider_6))
curve_frame = CurveFrame(Curve=extend_curve_2, Parameter=evaluate_length_6.Parameter)
deconstruct_plane = DeconstructPlane(Plane=curve_frame)  # -> Origin, XAxis, YAxis, ZAxis
plane_normal = PlaneNormal(Origin=evaluate_length_6.Point, ZAxis=deconstruct_plane.XAxis)
rectangle = Rectangle(Plane=plane_normal, XSize=construct_domain, YSize=construct_domain_2, Radius=0)  # -> Rectangle, Length
curve_3 = Curve(extend_curve_2)
vector_display_ex_2 = VectorDisplayEx(Point=evaluate_length_6.Point, Vector=deconstruct_plane.XAxis, Colour=RGB(0, 0, 0), Width=2)
graft_tree_2 = GraftTree(Tree=rectangle.Rectangle, IncludeEmptyLists=True, IncludeNullItems=True)
sweep1 = Sweep1(Rail=graft(curve_3), Sections=graft(rectangle.Rectangle), Miter=1)
cap_holes_2 = CapHoles(Brep=sweep1)

panel_25 = Panel(numbers_to_points)
point_list = PointList(Points=evaluate_length_5.Point, Size=Slider(1.92, range=0..10))
param_viewer_4 = ParamViewer(divide_curve_2.Points)
panel_26 = Panel(evaluate_length_5.Point)
polyline_7 = PolyLine(Vertices=divide_curve_2.Points, Closed=False)
panel_27 = Panel(divide_curve_2.Points)
param_viewer_5 = ParamViewer(flip_matrix_2)
