# Grasshopper definition lessson-3-code.gh (Grasshopper 1.0.7)

number_slider = Slider(35, range=0..100)
construct_domain = ConstructDomain(DomainStart="0", DomainEnd="1")
point = Point(Point(671.7946792, 140.431025, 0))
point_2 = Point(Point(668.7268157, 135.5905834, 0))
point_3 = Point([Point(680.7331148, 124.5812447, 0), Point(676.9304195, 126.691915, 0), Point(675.7617012, 125.8895114, 0)])
curve = Curve(<curve referenced from the Rhino model>)
merge = Merge(Data1=point, Data2=point_2)
number_slider_2 = Slider(5, range=0..100)
number_slider_3 = Slider(1.469, range=0..100)
curve_2 = Curve([<curve referenced from the Rhino model> x2])
curve_3 = Curve([<curve referenced from the Rhino model> x2])
merge_2 = Merge(Data1=Slider(2.802, range=0..100), Data2=Slider(1.839, range=0..100))
panel = Panel(merge_2)
gene_pool = GenePool(Decimals=2, Maximum=1, Minimum=0, Value=[0.34, 0.81, 0.22, 0.54, 0.41, 0.33, 0.67])
number_slider_4 = Slider(57.317, range=0..100)
populate_2d = Populate2D(Region=curve, Count=number_slider, Seed=Slider(45, range=0..100), Points=point_3)
random = Random(Range=construct_domain, Number=number_slider, Seed=Slider(51.92, range=0..100))
divide_curve = DivideCurve(Curve=curve_3, Count=3, Kinks=False)  # -> Points, Tangents, Parameters
divide_curve_2 = DivideCurve(Curve=curve_2, Count=3, Kinks=False)  # -> Points, Tangents, Parameters
circle = Circle(Plane=merge, Radius=merge_2)
panel_2 = Panel(merge)
panel_3 = Panel(circle)
evaluate_length = EvaluateLength(Curve=circle, Length=gene_pool, Normalized=True)  # -> Point, Tangent, Parameter
point_4 = Point(Point(670.2795993, 139.5344297, 0))
circle_2 = Circle(Plane=populate_2d, Radius=random)
construct_domain_2 = ConstructDomain(DomainStart=Slider(0.189, range=0..1), DomainEnd=Slider(0.898, range=0..1))
construct_domain_3 = ConstructDomain(DomainStart=Slider(0.189, range=0..1), DomainEnd=Slider(200, range=0..200))
panel_4 = Panel(divide_curve_2.Points)
panel_5 = Panel(point_4)
line = Line(StartPoint=point_4, EndPoint=evaluate_length.Point)
random_2 = Random(Range=construct_domain_3, Number=number_slider, Seed=Slider(39.875, range=0..100))
line_2 = Line(StartPoint=divide_curve_2.Points, EndPoint=divide_curve.Points)
point_list = PointList(Points=populate_2d, Size=Slider(0.753, range=0..12))
random_3 = Random(Range=construct_domain_2, Number=Slider(2, range=0..100), Seed=random_2)
param_viewer = ParamViewer(random_3)
panel_6 = Panel(divide_curve.Points)
param_viewer_2 = ParamViewer(random_2)
panel_7 = Panel(evaluate_length.Point)
panel_8 = Panel(circle_2)
point_5 = Point([Point(687.6582068, 122.9764375, 0), Point(686.4894885, 121.9647112, 0)])
panel_9 = Panel(random_2)
panel_10 = Panel(line_2)
panel_12 = Panel(line)
evaluate_length_2 = EvaluateLength(Curve=circle_2, Length=random_3, Normalized=True)  # -> Point, Tangent, Parameter
panel_13 = Panel(random_3)
param_viewer_3 = ParamViewer(circle_2)
