# Grasshopper definition parae_A path finding.gh (Grasshopper 1.0.7)
# plug-ins: Bifocals

number_slider = Slider(50, range=0..50)
startpoint = Point(Point(360.7412748, 409.2096126, 0))
endpoint = Point(Point(330.1915731, 379.367626, 0))
point = Point(Point(317.0398047, 367.3765868, 0))
# Created on Thu Sep 16 09:22:35 2021 @author: Richie Bao-parameterize_archi_la_design_and_data_analysis 西安建筑科技大学-规划/建筑/景观本科数字化系列课程
number_slider_2 = Slider(17, range=0..50)
rectangle = Rectangle(Plane=point, XSize=number_slider, YSize=number_slider, Radius=0)  # -> Rectangle, Length
curve = Curve(rectangle.Rectangle)
analysisboundary = PythonScript(rectangle=curve, cellsize=Slider(5, range=0..200), zvalue=Slider(0, range=-100..30))  # -> out, centerpoint, grid
# ---------- analysisboundary: Python ----------
import rhinoscriptsyntax as rs
from Grasshopper import DataTree
from Grasshopper.Kernel.Data import GH_Path
import Rhino,Grasshopper,System
rp=rs.PolylineVertices(rectangle)
def removeduplicate(lst):
    result=[]
    for v in lst:
        if v not in result:
            result.append(v)
    return result
rps=removeduplicate(rp)
xv=[a[0] for a in rps]
xmin=min(xv)
xmax=max(xv)
yv=[a[1] for a in rps]
ymin=min(yv)
ymax=max(yv)
xlst=[]
xvalue=xmin+cellsize/2
xlst.append(xvalue)
while True:
    xvalue+=cellsize
    if xvalue>xmax:break
    else:xlst.append(xvalue)
ylst=[]
yvalue=ymin+cellsize/2
ylst.append(yvalue)
while True:
    yvalue+=cellsize
    if yvalue>ymax:break
    else:ylst.append(yvalue)
centerpcoordi={}
cpdic=DataTree[System.Guid]()
for i in range(len(xlst)):
    tempc=[]
    tempq=[]
    ghpath=GH_Path(i)
    for j in ylst:
        tempc.append(rs.AddPoint([xlst[i],j,zvalue]))
        tempq.append([xlst[i],j])
    centerpcoordi[i]=tempq
    cpdic.AddRange(tempc,ghpath)
centerpoint=cpdic
gridtr=DataTree[System.Guid]()
for q in centerpcoordi.keys():
    gridr=[]
    ghpathgrid=GH_Path(q)
    for p in centerpcoordi[q]:
        print(p)
        bp=rs.WorldXYPlane()
        gridr.append(rs.AddRectangle(rs.MovePlane(bp,rs.AddPoint((p[0]-cellsize/2,p[1]-cellsize/2,zvalue))),cellsize,cellsize))
    gridtr.AddRange(gridr,ghpathgrid)
grid=gridtr
# ---------- end analysisboundary ----------
populate_2d = Populate2D(Region=rectangle.Rectangle, Count=number_slider_2, Seed=Slider(12.527, range=0..50))
curve_2 = Curve(analysisboundary.grid)
custom_preview = CustomPreview(Geometry=analysisboundary.centerpoint, Shader=ColourSwatch(SwatchColor=RGB(212, 212, 212)))
metaball_t = MetaBallT(Points=populate_2d, Plane=PlaneXY(0, 0, 0), Threshold=Slider(0.085, range=0..1))
a_pathfinding = PythonScript(
    centerpoint=analysisboundary.centerpoint,
    boundary=curve,
    closecurve=metaball_t,
    startpoint=startpoint,
    endpoint=endpoint,
    start=Toggle(True))  # -> out, path; inputs centerpoint: tree, closecurve: list
# ---------- a_pathfinding: Python ----------
import rhinoscriptsyntax as rs
from Grasshopper import DataTree
from Grasshopper.Kernel.Data import GH_Path
import Rhino,Grasshopper,System,math,sys,copy
def treetodic(treedata):
    dicname={}
    for i in range(treedata.BranchCount):
        branchlst=treedata.Branch(i)
        lst=[]
        for k in range(len(branchlst)):
            lst.append(branchlst[k])
        dicname[i]=lst
    return dicname
    
def flatten(nested):
    try:
        for sublist in nested:
            for element in flatten(sublist):
                yield element
    except TypeError:
        yield nested


tr=treetodic(centerpoint)
trpointnested=list(flatten(tr.values()))
boundarylist=[]
openlist=[]
closelist=[]
for i in trpointnested:
    num=rs.PointInPlanarClosedCurve(i,boundary)
    if num==0:
        closelist.append(i)
    else:
        boundarylist.append(i)
for i in boundarylist:
    temp=[]
    for p in closecurve:        
        numo=rs.PointInPlanarClosedCurve(i,p)
        temp.append(numo)
    if temp.count(0)==len(closecurve):
        openlist.append(i)
    else:closelist.append(i)



def dictotree(dicdata,datatype):
    treedata=DataTree[datatype]()
    for i in dicdata.keys():
        p=int(i)
        ghpath=GH_Path(p)
        treedata.AddRange(dicdata[i],ghpath)
    return treedata
    
def matrix(cp):
    matrix={}
    keys=cp.keys()
    for key in keys:
        if key==0:
            tempdic={}
            sublst=cp[key]
            sublstup=cp[key+1]
            for idx in range(len(sublst)):
                if idx==0:
                    matrix[sublst[idx]]=[sublst[idx+1],sublstup[idx],sublstup[idx+1]]
                elif idx==len(sublst)-1:
                    matrix[sublst[idx]]=[sublst[idx-1],sublstup[idx],sublstup[idx-1]]
                else:
                    matrix[sublst[idx]]=[sublst[idx+1],sublst[idx-1],sublstup[idx],sublstup[idx-1],sublstup[idx+1]]
        elif key==max(keys):
            tempdic={}
            sublst=cp[key]
            sublstdown=cp[key-1]
            for idx in range(len(sublst)):
                if idx==0:
                    matrix[sublst[idx]]=[sublst[idx+1],sublstdown[idx],sublstdown[idx+1]]
                elif idx==len(sublst)-1:
                    matrix[sublst[idx]]=[sublst[idx-1],sublstdown[idx],sublstdown[idx-1]]
                else:
                    matrix[sublst[idx]]=[sublst[idx+1],sublst[idx-1],sublstdown[idx],sublstdown[idx+1],sublstdown[idx-1]]
        else:
            tempdic={}
            sublst=cp[key]
            sublstup=cp[key+1]
            sublstdown=cp[key-1]
            for idx in range(len(sublst)):
                if idx==0:
                    tempdic[idx]={sublst[idx]:[sublst[idx+1],sublstup[idx],sublstup[idx+1],sublstdown[idx],sublstdown[idx+1]]}
                    matrix[sublst[idx]]=[sublst[idx+1],sublstup[idx],sublstup[idx+1],sublstdown[idx],sublstdown[idx+1]]
                elif idx==len(sublst)-1:
                    matrix[sublst[idx]]=[sublst[idx-1],sublstup[idx],sublstup[idx-1],sublstdown[idx],sublstdown[idx-1]]
                else:
                    matrix[sublst[idx]]=[sublst[idx+1],sublst[idx-1],sublstup[idx],sublstup[idx-1],sublstup[idx+1],sublstdown[idx],sublstdown[idx+1],sublstdown[idx-1]]
    return matrix
    
matrix=matrix(tr)

def s_e_closestpoint(startpoint,endpoint,openlist):
    startpoint=startpoint
    endpoint=endpoint
    openlist=openlist
    alst=[]
    def closestpoint(sepoint,openlist):
        dist=sys.maxsize
        for i in openlist:
            distance=rs.Distance(sepoint,i)
            if distance<dist:
                dist=distance
                closestp=i
        return closestp
    a=closestpoint(startpoint,openlist)
    alst.append(a)
    openlistcopy=copy.deepcopy(openlist)
    openlistcopy.remove(a)
    for i in range(3):
        b=closestpoint(startpoint,openlistcopy)
        alst.append(b)
        openlistcopy.remove(b)
    def s_e_point(alst,startpoint,endpoint):
        distmin=sys.maxsize
        for i in alst:
            distse=rs.Distance(startpoint,i)+rs.Distance(i,endpoint)
            if distse<distmin:
                distmin=distse
                closestpse=i
        return closestpse
    return s_e_point(alst,startpoint,endpoint)


class Node_Elem:
    def __init__(self, parent, point, dist):
        self.parent=parent
        self.point=point
        self.dist=dist
        
class A_Star:
    def __init__(self,s_closestpoint,e_closestpoint,openlist,closelist):
        self.startpoint=s_closestpoint
        self.endpoint=e_closestpoint
        self.openlist=openlist
        self.closelist=closelist
        self.open=[]
        self.close=[]
        self.path=[]
        
    def find_path(self):
        p=Node_Elem(None,self.startpoint,0.0)
        while True:
            self.extend_round(p)
            if not self.open:
                return
            idx,p=self.get_best()
            if p.point==self.endpoint:
                while p:
                    self.path.append(p.point)
                    p=p.parent
                return
            self.close.append(p)
            del self.open[idx]
            
    def extend_round(self,p):
        point=p.point
        for new_point in matrix[point]:
            if new_point in self.closelist or new_point in self.close :
                continue
            node=Node_Elem(p,new_point,p.dist+rs.Distance(p.point,new_point))
            if node.point in self.close:
                continue
            if node.point in self.open:
                i=self.open.index(node.point)
                if self.open[i].dist>node.dist:
                    self.open[i].parent=p
                    self.open[i].dist=node.dist
                continue
            self.open.append(node)

    def get_best(self):
        best=None
        bv=sys.maxsize
        bi=-1
        for idx,i in enumerate(self.open):
            value=i.dist+rs.Distance(self.endpoint,i.point)*1.2
            if value<bv:
                best=i
                bv=value
                bi=idx
        return bi,best
        

def find_path():  
    s_closestpoint=s_e_closestpoint(startpoint,endpoint,openlist)
    e_closestpoint=s_e_closestpoint(endpoint,startpoint,openlist)
    a_star=A_Star(s_closestpoint,e_closestpoint,openlist,closelist)
    a_star.find_path()
    path=a_star.path
    return path


if start==True:
    path=find_path()
# ---------- end a_pathfinding ----------
point_2 = Point(a_pathfinding.path)
interpolate = Interpolate(Vertices=a_pathfinding.path, Degree=3, Periodic=False, KnotStyle=1)  # -> Curve, Length, Domain
custom_preview_2 = CustomPreview(Geometry=interpolate.Curve, Shader=ColourSwatch(SwatchColor=RGB(255, 0, 0)))
dot_display = DotDisplay(Point=point_2, Colour=RGB(0, 0, 0), Size=Slider(0.973, range=0..20))
