# Grasshopper definition parae_GIS elevation data importation.gh (Grasshopper 1.0.7)
# plug-ins: Bifocals

file_path = FilePath("C:\Users\richi\omen_richiebao\omen_github\parameterize_archi_la_design_and_data_analysis\data\Slop30.txt")
read_file = ReadFile(File=file_path, PerLineParse=True)
text_split = StringSplit(String=read_file, Separators=",")
list_item = ListItem(List=text_split, Index="2", Wrap=True)
flatten_tree = FlattenTree(Data=list_item, Path="{0}")

# ----
# Created on Sun Sep 12 17:53:09 2021@author: Richie Bao-parameterize_archi_la_design_and_data_analysis 西安建筑科技大学-规划/建筑/景观本科数字化系列课程
file_path_2 = FilePath("C:\Users\richi\omen_richiebao\omen_github\parameterize_archi_la_design_and_data_analysis\data\Elevation30.txt")
read_file_2 = ReadFile(File=file_path_2, PerLineParse=True)
panel = Panel(file_path_2)
text_split_2 = StringSplit(String=read_file_2, Separators=",")
list_item_2 = ListItem(List=text_split_2, Index="2", Wrap=True)  # -> flatten(Item)
numbers_to_points = NumbersToPoints(Numbers=text_split_2, Mask=4)  # -> flatten(Points)
panel_2 = Panel(text_split_2)
sort_list = SortList(Keys=list_item_2, ValuesValuesA=numbers_to_points)  # -> Keys, ValuesValuesA
list_item_3 = ListItem(List=sort_list.ValuesValuesA, Index="0", Wrap=True)
xy_plane = XYPlane(Origin=list_item_3)
delaunay_mesh = DelaunayMesh(Points=numbers_to_points, Plane=xy_plane)

panel_3 = Panel("""0
2
5
15
25
35
55
88.9""")
classification = PythonScript(data=flatten_tree, classification=panel_3)  # -> out, clalist; inputs data: list, classification: list
# ---------- classification: Python ----------
# sample script to show how to use this component and rhinoscriptsyntax
import math
import rhinoscriptsyntax as rs
data=data
da=[]
for j in data:
    da.append(float(j))
data=da
print(data)
cal=classification
print(cal)
for i in cal:
    cal[cal.index(i)]=float(i)
print(cal)
for k in range(len(cal)-1):
    a=cal[k]
    b=cal[k+1]
    for q in range(len(data)):
        if a<=data[q]<b:
            data[q]=a
for w in range(len(data)):
    if data[w]>=cal[-1]:
        data[w]=0

print(data)


clalist=data
# ---------- end classification ----------
bounds = Bounds(Numbers=classification.clalist)
domcomp = DomainComponents(Domain=bounds)  # -> Start, End
gradient = Gradient(
    LowerLimit=domcomp.Start,
    UpperLimit=domcomp.End,
    Parameter=classification.clalist,
    stops=[0: RGB(243, 57, 0), 0: RGB(236, 27, 60), 0.0872: RGB(210, 0, 118), 0.3: RGB(103, 0, 120), 0.4: RGB(39, 72, 161), 0.5: RGB(1, 192, 229), 0.6: RGB(18, 178, 90), 0.7: RGB(79, 186, 8), 0.8: RGB(220, 237, 32), 0.9: RGB(247, 159, 20), 1: RGB(243, 57, 0)])
legend = PythonScript(color=gradient, value=classification.clalist, switch=Toggle(True))  # -> out, symcolor, symvalue; inputs color: list, value: list
# ---------- legend: Python ----------
# sample script to show how to use this component and rhinoscriptsyntax
import math
import rhinoscriptsyntax as rs
color=color
value=value
selectvalue=value
boolean=switch
print(boolean)

def classification(color,value,selectvalue):
    color=color
    value=value
    selectvalue=selectvalue
    symcolor=[]
    symvalue=[]
    sym=[]
    for m in value:
        for n in range(len(selectvalue)):
            if selectvalue[n]==m:
                selectvalue[n]=None
        sym.append(m)
    for i in range(len(sym)):
        if sym[i]!=None:
            symvalue.append(sym[i])
            symcolor.append(color[i])
    return symvalue,symcolor
if boolean==True:
    symvalue,symcolor=classification(color,value,selectvalue)
    


print(symvalue)
print(symcolor)
# ---------- end legend ----------
curve = Curve(<curve referenced from the Rhino model>)
legend_2 = Legend(Colour=legend.symcolor, Tags=legend.symvalue, Rectangle=curve, LegendType=1)
pie_chart = PieChart(classification.clalist)
mesh_colours = MeshColours(Mesh=delaunay_mesh, Colours=gradient)

deconstruct = Deconstruct(Point=numbers_to_points)  # -> XComponent, YComponent, ZComponent
unit_z = UnitZ(Factor=1)
sort_list_2 = SortList(Keys=deconstruct.ZComponent, ValuesValuesA=numbers_to_points)  # -> Keys, ValuesValuesA
list_item_4 = ListItem(List=sort_list_2.ValuesValuesA, Index=0, Wrap="0")
contour = Contour(Shape=delaunay_mesh, Point=list_item_4, Direction=unit_z, Distance=Slider(10.979, range=0..20))

deconstruct_2 = Deconstruct(Point=numbers_to_points)  # -> XComponent, YComponent, flatten(ZComponent)
division = Division(A=deconstruct_2.ZComponent, B="20")
round = Round(Number=division)  # -> Nearest, Floor, Ceiling

multiplication = Multiplication(A=round.Ceiling, B="20")
curve_2 = Curve(<curve referenced from the Rhino model>)

bounds_2 = Bounds(Numbers=multiplication)
deconstruct_domain = DeconstructDomain(Domain=bounds_2)  # -> Start, End
gradient_2 = Gradient(
    LowerLimit=deconstruct_domain.Start,
    UpperLimit=deconstruct_domain.End,
    Parameter=multiplication,
    stops=[0: RGB(243, 57, 0), 0.1: RGB(236, 27, 60), 0.2: RGB(210, 0, 118), 0.3: RGB(103, 0, 120), 0.4: RGB(39, 72, 161), 0.5: RGB(1, 192, 229), 0.6: RGB(18, 178, 90), 0.7: RGB(79, 186, 8), 0.8: RGB(220, 237, 32), 0.9: RGB(247, 159, 20), 1: RGB(243, 57, 0)])
sort_list_3 = SortList(Keys=multiplication, ValuesValuesA=gradient_2)  # -> Keys, ValuesValuesA
delete_consecutive = DeleteConsecutive(Set=sort_list_3.ValuesValuesA, Wrap=False)  # -> Set, Count
delete_consecutive_2 = DeleteConsecutive(Set=sort_list_3.Keys, Wrap=False)  # -> Set, Count
mesh_colours_2 = MeshColours(Mesh=delaunay_mesh, Colours=gradient_2)
legend_3 = Legend(Colour=delete_consecutive.Set, Tags=delete_consecutive_2.Set, LegendType=1)
