# Grasshopper definition parae_arch position.gh (Grasshopper 1.0.7)
# plug-ins: karambaGH, Bifocals

construct_point = PointXYZ(XCoordinate=0, YCoordinate=0, ZCoordinate=0)
construct_point_2 = PointXYZ(XCoordinate=10, YCoordinate=0, ZCoordinate=0)
# Created on Mon Sep 20 11:25:23 2021@author: Richie Bao-parameterize_archi_la_design_and_data_analysis 西安建筑科技大学-规划/建筑/景观本科数字化系列课程
slider = Slider(13.4, range=10.1..50)
unit_z = UnitZ(Factor="3.5")
catenary = Catenary(PointA=construct_point_2, PointB=construct_point, Length=slider, Gravity=Vector(0, 0, 10))
divide_curve = DivideCurve(Curve=catenary, Number=10, Kinks=False)  # -> Points, Tangents, Parameters
polyline = PolyLine(Vertices=divide_curve.Points, Closed=False)
explode = Explode(Curve=polyline, Recursive=True)  # -> Segments, Vertices
reverse = Reverse(Vector=unit_z)
series = Series(Start=1, Step=1, Count=9)
number = Number([0, 10])
support_karamba3d = Support(PosInd=number, menu=[buttons(on, on, on, on, off, off)])
line_to_beam_karamba3d = LineToBeamKaramba3D(Line=explode.Segments, New=True, Remove=True, LimitDistance_m=0.005)  # -> Element, Points, Info
loads_karamba3d = LoadsKaramba3D(ForceVector=reverse, Local=False, PosInd=series, LCase=0, mode="Point")
loads_karamba3d_2 = LoadsKaramba3D(Vector=Vector(0, 0, -1), LCase=0, mode="Gravity")
entwine = Entwine(Branch00=loads_karamba3d, Branch01=loads_karamba3d_2, FlattenInputs=True)  # -> flatten(Result)
assemble_model_karamba3d = AssembleModelKaramba3D(Elem=line_to_beam_karamba3d.Element, Support=support_karamba3d, Load=entwine, LimitDistance_m=0.005)  # -> Model, Info, Mass_kg, CenterOfGravity
analyze_karamba3d = AnalyzeKaramba3D(Model=assemble_model_karamba3d.Model)  # -> CalculatedModel, MaximumDisplacement_cm, ResultingForceOfGravity_kN, ElasticEnergy_kNm
model_view_karamba3d = ModelViewKaramba3D(Model=analyze_karamba3d.CalculatedModel, ResultFactors=1, ResultCase=-1)  # -> Model, DeformedMesh, DeformedAxes, DeformedModel
number_2 = Number(flatten(analyze_karamba3d.MaximumDisplacement_cm))
galapagos = Galapagos(fitness=number_2, gene=slider)
panel = Panel(number_2)

slider_2 = Slider(17.5, range=10.1..50)
panel_2 = Panel("0.078096")

beam_view_karamba3d = BeamViewKaramba3D(Model=model_view_karamba3d.Model)  # -> Model, MeshesOfRenderedBeams, DeformedBeamAxes, LegendColors, LegendTags
legend = Legend(Colour=beam_view_karamba3d.LegendColors, Tags=beam_view_karamba3d.LegendTags, LegendType=1)
