# Grasshopper definition parae_arch.gh (Grasshopper 1.0.7)
# plug-ins: Bifocals, Kangaroo2 Components

# Created on Mon Sep 20 23:45:16 20212021@author: Richie Bao-parameterize_archi_la_design_and_data_analysis 西安建筑科技大学-规划/建筑/景观本科数字化系列课程
point = Point(Point(64.34943735, -10.37446424, 0))
number_slider = Slider(1.058, range=0..30)
negative = Negative(Value=number_slider)
number_slider_2 = Slider(35, range=0..100)
construct_domain = ConstructDomain(DomainStart=number_slider, DomainEnd=negative)
rectangle = Rectangle(Plane=point, XSize=construct_domain, YSize=construct_domain, Radius=0)  # -> Rectangle, Length
rectangular_array = RectangularArray(Geometry=point, Cell=rectangle.Rectangle, XCount=number_slider_2, YCount=number_slider_2)  # -> Geometry, Transform
partition_list = PartitionList(List=rectangular_array.Geometry, Size=number_slider_2)
tree_statistics = TreeStatistics(Tree=partition_list)  # -> Paths, Length, Count
integer_division = IntegerDivision(A=tree_statistics.Count, B="2")
cull_index = CullIndex(List=tree_statistics.Paths, Indices=integer_division, Wrap=True)
tree_branch = TreeBranch(Tree=partition_list, Path=cull_index, MaintainPaths=True)
list_item = ListItem(List=tree_statistics.Paths, Index=integer_division, Wrap=True)
tree_branch_2 = TreeBranch(Tree=partition_list, Path=list_item, MaintainPaths=True)
list_length = ListLength(List=tree_branch_2)
integer_division_2 = IntegerDivision(A=list_length, B="2")
list_item_2 = ListItem(List=tree_statistics.Paths, Index="0", Wrap=True)
list_item_3 = ListItem(List=reverse(tree_statistics.Paths), Index="0", Wrap=True)
list_item_4 = ListItem(List=tree_branch_2, Index=integer_division_2, Wrap=True)
merge = Merge(Data1=list_item_2, Data2=list_item_3)
list_item_5 = ListItem(List=tree_branch_2, Index="0", Wrap=True)
list_item_6 = ListItem(List=reverse(tree_branch_2), Index="0", Wrap=True)
tree_branch_3 = TreeBranch(Tree=partition_list, Path=merge, MaintainPaths=True)
unit_z = UnitZ(Factor=Slider(13.945, range=0..30))
move = Move(Geometry=list_item_4, Motion=unit_z)  # -> Geometry, Transform
list_item_7 = ListItem(List=reverse(tree_branch_3), Index="0", Wrap=True)
list_item_8 = ListItem(List=tree_branch_3, Index="0", Wrap=True)
arc_3pt = Arc3Pt(PointA=list_item_5, PointB=move.Geometry, PointC=list_item_6)  # -> Arc, Plane, Radius
curve_closest_point = CurveClosestPoint(Point=tree_branch_2, Curve=arc_3pt.Arc)  # -> Point, Parameter, Distance
merge_2 = Merge(Data1=list_item_8, Data2=list_item_7, Data3=curve_closest_point.Point)  # -> flatten(Result)
merge_3 = Merge(Data1=tree_branch, Data2=curve_closest_point.Point)
python_grouperaccylinder_mtl = PythonScript(TreeData=merge_3)  # -> out, simplify(PLst); inputs TreeData: tree of GeometryBase
# ---------- python_grouperaccylinder_mtl: Python ----------
import Rhino
import rhinoscriptsyntax as rs
from Grasshopper import DataTree
from Grasshopper.Kernel.Data import GH_Path
data=TreeData
branches=data.Branches
PT=DataTree[Rhino.Geometry.GeometryBase]()
def grouper(branches,dt):
    for m in range(len(branches)-1):
        a=branches[m]
        b=branches[m+1]
        for i in range(len(a)-1):
            lst=[]
            lst.append(b[i])
            lst.append(a[i])
            lst.append(b[i+1])
            lst.append(a[i+1])
            dt.AddRange(lst,GH_Path(m,i))
    return dt
PLst=grouper(branches,PT)
# ---------- end python_grouperaccylinder_mtl ----------
mesh_quad = MeshQuad(CornerA="0", CornerB="1", CornerC="3", CornerD="2")
anchor = Anchor(Point=merge_2, Strength=10000)
construct_mesh = ConstructMesh(Vertices=python_grouperaccylinder_mtl.PLst, Faces=mesh_quad)
mesh_join = MeshJoin(Meshes=flatten(construct_mesh))
edgelengths = EdgeLengths(Mesh=mesh_join, LengthFactor=Slider(0.474, range=0..1), Strength=Slider(0.178, range=0..1))
show = Show(G=mesh_join)
entwine = Entwine(Branch00=edgelengths, Branch01=anchor, Branch02=show, FlattenInputs=True)
timer = Timer(Interval=20, TimerInterval=20, Target=stepsolver)  # disabled
stepsolver = StepSolver(
    GoalObjects=entwine,
    Tolerance=0.01,
    Momentum=Toggle(True),
    Damping=Slider(0.685, range=0..1),
    SubIterations=10,
    Animate=Toggle(True))  # -> I, V, O
