# Grasshopper definition parae_box flatten.gh (Grasshopper 1.0.7)
# plug-ins: Bifocals

number_slider = Slider(6.01, range=0..20)
# Created on Sat Sep 18 22:12:34 2021@author: Richie Bao-parameterize_archi_la_design_and_data_analysis 西安建筑科技大学-规划/建筑/景观本科数字化系列课程
point = Point(Point(0, 81.49738571, -12.13960758))
construct_domain = ConstructDomain(DomainStart=Slider(0, range=0..1), DomainEnd=Slider(100, range=0..100))
rectangle = Rectangle(Plane=point, XSize=number_slider, YSize=number_slider, Radius=0)  # -> Rectangle, Length
unit_z = UnitZ(Factor=Slider(2.4, range=0..20))
move = Move(Geometry=rectangle.Rectangle, Motion=unit_z)  # -> Geometry, Transform
number_slider_2 = Slider(70, range=0..100)
number_slider_3 = Slider(83, range=0..100)
point_2 = Point([Point(8.214321686, 91.27853394, 0), Point(11.81183504, 95.15277908, 0), Point(12.36529863, 90.30997265, 0)])
merge = Merge(Data1=rectangle.Rectangle, Data2=move.Geometry)
list_length = ListLength(List=merge)
random = Random(Range=construct_domain, Number=list_length, Seed=Slider(14.093, range=0..100), Integers=False)
populate_2d = Populate2D(Region=merge, Count=Slider(4, range=0..20), Seed=random)
panel = Panel(point_2)
sort_along_curve = SortAlongCurve(Points=populate_2d, Curve=rectangle.Rectangle)  # -> Points, Indices
reverse_list = ReverseList(List=sort_along_curve.Points)
list_item = ListItem(List=sort_along_curve.Points, Index="0", Wrap=True)
mesh_quad = MeshQuad(CornerA="0", CornerB="1", CornerC="3", CornerD="2")
mesh_quad_2 = MeshQuad(CornerA="0", CornerB="1", CornerC="2", CornerD="3")
construct_mesh = ConstructMesh(Vertices=sort_along_curve.Points, Faces=mesh_quad_2)
insert_items = InsertItems(List=reverse_list, Item=list_item, Indices="0", Wrap=True)
python_grouperaccylinder_mtl = PythonScript(TreeData=insert_items)  # -> out, simplify(PLst); inputs TreeData: tree of GeometryBase
# ---------- python_grouperaccylinder_mtl: Python ----------
import Rhino
import rhinoscriptsyntax as rs
from Grasshopper import DataTree
from Grasshopper.Kernel.Data import GH_Path
data=TreeData
branches=data.Branches
PT=DataTree[Rhino.Geometry.GeometryBase]()
def grouper(branches,dt):
    for m in range(len(branches)-1):
        a=branches[m]
        b=branches[m+1]
        for i in range(len(a)-1):
            lst=[]
            lst.append(b[i])
            lst.append(a[i])
            lst.append(b[i+1])
            lst.append(a[i+1])
            dt.AddRange(lst,GH_Path(m,i))
    return dt
PLst=grouper(branches,PT)
#richie
# ---------- end python_grouperaccylinder_mtl ----------
construct_mesh_2 = ConstructMesh(Vertices=python_grouperaccylinder_mtl.PLst, Faces=mesh_quad)
merge_2 = Merge(Data1=construct_mesh_2, Data2=construct_mesh)  # -> flatten(Result)
triangulate = Triangulate(Mesh=merge_2)  # -> Mesh, Count
mesh_join = MeshJoin(Meshes=triangulate.Mesh)
deconstruct_mesh = DeconstructMesh(Mesh=mesh_join)  # -> Vertices, graft(Faces), Colours, Normals
construct_mesh_3 = ConstructMesh(Vertices=deconstruct_mesh.Vertices, Faces=deconstruct_mesh.Faces)  # -> flatten(Mesh)
mesh_edges = MeshEdges(Mesh=construct_mesh_3)  # -> NakedEdges, InteriorEdges, NonManifoldEdges
mesh_join_2 = MeshJoin(Meshes=construct_mesh_3)
meshtopology = PythonScript(Mesh=mesh_join_2)  # -> out, MeshFlatten; inputs Mesh: list
# ---------- meshtopology: Python ----------
import rhinoscriptsyntax as rs
import Rhino
import System
from Grasshopper import DataTree
from Grasshopper.Kernel.Data import GH_Path
mesh=rs.ExplodeMeshes(Mesh)
meshv={}
for i in range(len(mesh)):
    meshv[i]=rs.MeshVertices(mesh[i])
meshvkeys=meshv.keys()
meshvvalues=meshv.values()
tdic={}.fromkeys(meshvkeys)
for i in meshvkeys:
    tlist=[]
    a=meshvvalues[i]
    for n in meshvvalues:
        temp=[]
        for f in a:
            if f in n:
                temp.append(True)
        tlist.append(temp)
    tdic[i]=tlist
topologydic={}.fromkeys(meshvkeys)
for i in meshvkeys:
    b=tdic[i]
    tempa=[]
    for j in range(len(b)):
        if len(b[j])==2:
            tempa.append(j)
    topologydic[i]=tempa
MeshFlatten=DataTree[System.Int32]()
for i in  meshvkeys:
    path=GH_Path(i)
    v=topologydic[i]
    MeshFlatten.AddRange(v,path)
# ---------- end meshtopology ----------
flattenbox = PythonScript(Mesh=mesh_join_2, MeshTopology=meshtopology.MeshFlatten, LocationPoint=point_2, Finding=Button(), Count=number_slider_3)  # -> out, BoxFlatten, Order; inputs MeshTopology: tree, LocationPoint: list
# ---------- flattenbox: Python ----------
import rhinoscriptsyntax as rs
import Rhino
import System
import random
import copy
from Grasshopper import DataTree
from Grasshopper.Kernel.Data import GH_Path
mesh=rs.ExplodeMeshes(Mesh)
meshv={}
for i in range(len(mesh)):
    meshv[i]=rs.MeshVertices(mesh[i])
meshvkeys=meshv.keys()
meshvvalues=meshv.values()
tdic={}.fromkeys(meshvkeys)
datat=MeshTopology
Glst={}
for i in range(datat.BranchCount):
    branchlst=datat.Branch(i)
    lst=[]
    for k in range(len(branchlst)):
        lst.append(branchlst[k])
    Glst[i]=lst
ordorlst=[]
allowlst=copy.deepcopy(Glst)
startmesh=random.choice(allowlst.keys())
def order(allowlst,startmesh):
    if len(allowlst)==0:
        return ordorlst
    else:
        ordorlst.append(startmesh)
        tmesh=allowlst[startmesh]
        allowlst.pop(startmesh)
        if tmesh==[]:
            allowlst=copy.deepcopy(Glst)
            return order(allowlst,random.choice(allowlst.keys()))
        else:
            sidxt=random.choice(tmesh)
            startmesh=sidxt
        for i in allowlst.keys():
            if startmesh in allowlst[i]:
                allowlst[i].remove(startmesh)
            elif sidxt in allowlst[i]:
                allowlst[i].remove(sidxt)
            else:pass
        return order(allowlst,startmesh)

for i in range(int(Count)):
    try:
        u=order(allowlst,startmesh)
    except KeyError:
        pass

ordermesh=[mesh[i] for i in u]
Order=u

def flattenmesh(meshes,LocationPoint):
    lp=[]
    for i in LocationPoint:
        lp.append(rs.PointCoordinates(i))
    xymeshes=[]
    for i in range(len(meshes)):
        if i ==0:
            mesh0point=rs.MeshVertices(meshes[i])
            xymesh0=rs.OrientObject(meshes[i], mesh0point,lp,1)
            xymeshes.append(xymesh0)
        else:
            vertices2=rs.MeshVertices(meshes[i])
            vertices1=rs.MeshVertices(meshes[i-1])
            ver=[m for m in vertices1 for n in vertices2 if m==n]
            a=ver[0]
            b=ver[1]
            indexa=vertices1.index(a)
            indexb=vertices1.index(b)
            d=[m for m in vertices2 if m not in ver][0]
            refvertice=rs.MeshVertices(xymeshes[i-1])
            indexc=[c for c in range(0,3) if c !=indexa and c!=indexb]
            refverticespoint=rs.MirrorObject(rs.AddPoint(refvertice[indexc[0]]),refvertice[indexa],refvertice[indexb])
            mirrorpoint=rs.PointCoordinates(refverticespoint)
            xymesh=rs.OrientObject(meshes[i],[a,b,d],[refvertice[indexa],refvertice[indexb],mirrorpoint],1) 
            xymeshes.append(xymesh)
        vertices2lst=[]
        vertices1lst=[] 
        ver=[]
    return xymeshes

BoxFlatten=flattenmesh(ordermesh,LocationPoint)
#richie
# ---------- end flattenbox ----------
mesh_edges_2 = MeshEdges(Mesh=flattenbox.BoxFlatten)  # -> NakedEdges, InteriorEdges, NonManifoldEdges
text_tag_3d = TextTag3D(Text=flattenbox.Order, Size=Slider(1, range=0..1), Justification=7)
join_curves = JoinCurves(Curves=mesh_edges_2.NakedEdges, Preserve=False)
galapagos = Galapagos(fitness=mass_addition, gene=number_slider_3)
area = Area(Geometry=join_curves)  # -> flatten(Area), Centroid
mass_addition = MassAddition(Input=area.Area)  # -> Result, PartialResults
panel_2 = Panel(mass_addition.Result)
