# Grasshopper definition parae_build the terrain with given contours.gh (Grasshopper 1.0.7)
# plug-ins: Bifocals

# Created on Sun Sep 12 16:31:25 2021@author: Richie Bao-parameterize_archi_la_design_and_data_analysis 西安建筑科技大学-规划/建筑/景观本科数字化系列课程
contours = Curve([<curve referenced from the Rhino model> x8])
contours_2 = Curve([<curve referenced from the Rhino model> x5])
contours_3 = Curve([<curve referenced from the Rhino model> x6])
curve = Curve(<curve referenced from the Rhino model>)
curve_2 = Curve(<curve referenced from the Rhino model>)
curve_3 = Curve(<curve referenced from the Rhino model>)
unit_z = UnitZ(Factor="3.05")
根据参考线赋值高程 = 根据参考线赋值高程(contours=contours, text_size=Slider(0.304, range=0..1), pl_ref=curve, start_elevation_contour="0", step_contour="0.5")
根据参考线赋值高程_2 = 根据参考线赋值高程(
    contours=contours_2,
    text_size=Slider(0.304, range=0..1),
    pl_ref=curve_2,
    start_elevation_contour="0",
    step_contour="0.5")
根据参考线赋值高程_3 = 根据参考线赋值高程(
    contours=contours_3,
    text_size=Slider(0.304, range=0..1),
    pl_ref=curve_3,
    start_elevation_contour="0",
    step_contour="0.5")
curve_4 = Curve(<curve referenced from the Rhino model>)
move = Move(Geometry=curve_4, Motion=unit_z)  # -> Geometry, Transform
boundary = Curve(<curve referenced from the Rhino model>)
curve_5 = Curve(根据参考线赋值高程)
curve_6 = Curve(根据参考线赋值高程_2)
curve_7 = Curve(根据参考线赋值高程_3)
curve_8 = Curve(move.Geometry)
entwine = Entwine(
    Branch00=根据参考线赋值高程,
    Branch01=根据参考线赋值高程_3,
    Branch02=根据参考线赋值高程_2,
    Branch03=move.Geometry,
    Branch04=boundary,
    FlattenInputs=True)

evaluate_length = EvaluateLength(Curve=entwine, Length=Slider(0.889, range=0..1), Normalized=True)  # -> Point, Tangent, Parameter
deconstruct = Deconstruct(Point=evaluate_length.Point)  # -> XComponent, YComponent, ZComponent
text_tag_3d = TextTag3D(
    Location=evaluate_length.Point,
    Text=deconstruct.ZComponent,
    Size=Slider(0.546, range=0..10),
    Colour=ColourSwatch(SwatchColor=RGB(0, 0, 0)),
    Justification=7)

三维地形 = 三维地形(输入等高线=entwine, 精度=Slider(0.904, range=0..1), 等高线间距=Slider(0.549, range=0..20))  # -> 等高线, 地形表面, 高程点
curve_9 = Curve(三维地形.等高线)
mesh = Mesh(三维地形.地形表面)
smooth_polyline = SmoothPolyline(Polyline=三维地形.等高线, Strength=1, Times=Slider(2, range=0..20))
三维地形_2 = 三维地形(输入等高线=smooth_polyline, 精度=Slider(0.549, range=0..1), 等高线间距=Slider(0.612, range=0..20))  # -> 等高线, 地形表面, 高程点

curve_10 = Curve(<curve referenced from the Rhino model>)
curve_11 = Curve(<curve referenced from the Rhino model>)
curve_12 = Curve(<curve referenced from the Rhino model>)
curve_13 = Curve(<curve referenced from the Rhino model>)
curve_14 = Curve(<curve referenced from the Rhino model>)
curve_15 = Curve(<curve referenced from the Rhino model>)
gene_pool = GenePool(Decimals=2, Maximum=20, Minimum=-20, Value=[0, 3.07, 4.3, 5.67, -3.21, -5.85])
entwine_2 = Entwine(
    Branch00=curve_10,
    Branch01=curve_11,
    Branch02=curve_12,
    Branch03=curve_13,
    Branch04=curve_14,
    Branch05=curve_15,
    FlattenInputs=True)
unit_z_2 = UnitZ(Factor=gene_pool)
smooth_polyline_2 = SmoothPolyline(Polyline=entwine_2, Strength=1, Times=Slider(1, range=0..20))
move_2 = Move(Geometry=smooth_polyline_2, Motion=graft(unit_z_2))  # -> Geometry, Transform

# ==== cluster 三维地形
输入等高线 = ClusterInput()
geometry_pipeline = GeometryPipeline(
    GroupByLayer=False,
    GroupByType=False,
    IncludeHidden=True,
    IncludeLocked=True,
    LayerFilter="ADJTerrain",
    NameFilter="*",
    SublayerFiltering=False,
    TypeFilter=4)
number_slider = Slider(0.25, range=0..1)
精度 = ClusterInput()
length = Length(Curve=输入等高线)
multiplication = Multiplication(A=length, B=精度)
等高线间距 = ClusterInput()
number_slider_2 = Slider(5, range=0..20)
unit_z = UnitZ(Factor=1)
round = Round(Number=multiplication)  # -> Nearest, Floor, Ceiling
divide_curve = DivideCurve(Curve=输入等高线, Count=round.Ceiling, Kinks=False)  # -> flatten(Points), Tangents, Parameters
deconstruct = Deconstruct(Point=divide_curve.Points)  # -> XComponent, YComponent, ZComponent
高程点 = ClusterOutput(divide_curve.Points)
sort_list = SortList(Keys=deconstruct.ZComponent, ValuesValuesA=divide_curve.Points)  # -> Keys, ValuesValuesA
delaunay_mesh = DelaunayMesh(Points=divide_curve.Points, Plane=PlaneXY(0, 0, 0))
地形表面 = ClusterOutput(delaunay_mesh)
list_item = ListItem(List=sort_list.ValuesValuesA, Index=0, Wrap="0")
contour = Contour(Shape=delaunay_mesh, Point=list_item, Direction=unit_z, Distance=等高线间距)
等高线 = ClusterOutput(contour)

# ==== cluster 根据参考线赋值高程

# ---- group: step_contour
start_elevation_contour = ClusterInput()

# ---- group: Cluster Input
contours = ClusterInput()

# ---- group: PL_ref
step_contour = ClusterInput()

# ---- group: contours
pl_ref = ClusterInput()

# ----
curve_curve = CurveCurve(CurveA=contours, CurveB=pl_ref)  # -> flatten(Points), ParamsA, flatten(ParamsB)
sort_list = SortList(Keys=curve_curve.ParamsB, ValuesValuesA=contours)  # -> Keys, ValuesValuesA
list_length = ListLength(List=sort_list.ValuesValuesA)
series = Series(Start=start_elevation_contour, Step=step_contour, Count=list_length)
evaluate_length = EvaluateLength(Curve=pl_ref, Length=sort_list.Keys, Normalized=False)  # -> Point, Tangent, Parameter
item_index = ItemIndex(List=curve_curve.Points, Item=curve_curve.Points)
unit_z = UnitZ(Factor=series)

# ---- group: start_elevation_contour
text_size = ClusterInput()

# ----
text_tag_3d = TextTag3D(Location=evaluate_length.Point, Text=item_index, Size=text_size, Justification=7)
move = Move(Geometry=sort_list.ValuesValuesA, Motion=unit_z)  # -> Geometry, Transform

# ---- group: Cluster Output
contours_with_elevation = ClusterOutput(move.Geometry)
