# Grasshopper definition parae_eco_UTCI.gh (Grasshopper 1.0.7)
# plug-ins: Bifocals

# Import EPW
file_path = FilePath("C:\Users\richi\omen_richiebao\omen_github\parameterize_archi_la_design_and_data_analysis\data\CHN_Shaanxi.Xian.570360_CSWD.epw")
importepw = LBImportEPW(epw_file=file_path)  # -> location, dry_bulb_temperature, dew_point_temperature, relative_humidity, wind_speed, wind_direction, direct_normal_rad, diffuse_horizontal_rad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; plug-in component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
# Compute MRT in the Sun
toggle = BooleanToggle(True)
outdoorsolarmrt = LBOutdoorSolarMRT(
    location=importepw.location,
    surface_temp=importepw.dry_bulb_temperature,
    dir_norm_rad=importepw.direct_normal_rad,
    diff_horiz_rad=importepw.diffuse_horizontal_rad,
    horiz_infrared=importepw.horizontal_infrared_rad,
    run=toggle)  # -> report, short_erf, long_erf, short_dmrt, long_dmrt, mrt; plug-in component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
toggle_2 = BooleanToggle(True)
# Sun and Wind
utci = LBUTCIComfort(
    air_temp=importepw.dry_bulb_temperature,
    mrt=outdoorsolarmrt.mrt,
    rel_humid=importepw.relative_humidity,
    wind_vel=importepw.wind_speed,
    run=toggle_2)  # -> report, utci, comfort, condition, category, comf_obj; plug-in component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
# Wind and No Sun
utci_2 = LBUTCIComfort(
    air_temp=importepw.dry_bulb_temperature,
    rel_humid=importepw.relative_humidity,
    wind_vel=importepw.wind_speed,
    run=toggle_2)  # -> report, utci, comfort, condition, category, comf_obj; plug-in component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
# No Wind and No Sun
utci_3 = LBUTCIComfort(air_temp=importepw.dry_bulb_temperature, rel_humid=importepw.relative_humidity, run=toggle_2)  # -> report, utci, comfort, condition, category, comf_obj; plug-in component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
# Sun and No Wind
utci_4 = LBUTCIComfort(air_temp=importepw.dry_bulb_temperature, mrt=outdoorsolarmrt.mrt, rel_humid=importepw.relative_humidity, run=toggle_2)  # -> report, utci, comfort, condition, category, comf_obj; plug-in component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
# % of Time Comfortable
comfstat = LBComfortStatistics(comf_obj=[utci.comf_obj, utci_4.comf_obj, utci_2.comf_obj, utci_3.comf_obj])  # -> pct_hot, pct_neutral, pct_cold; plug-in component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

# ----
# Plot on an Hourly Chart
panel = Panel("-3")
legendpar = LBLegendParameters(min=panel, max="3", text_height="4")  # -> leg_par; plug-in component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
hourlyplot = LBHourlyPlot(data=[utci.category, utci_4.category, utci_2.category, utci_3.category], legend_par=legendpar)  # -> report, mesh, legend, borders, labels, title; plug-in component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
geo = Geometry([hourlyplot.mesh, hourlyplot.legend, hourlyplot.borders, hourlyplot.labels])

panel_2 = Panel(comfstat.pct_neutral)
