# Grasshopper definition parae_eco_epwPlot.gh (Grasshopper 1.0.7)
# plug-ins: Bifocals

file_path = FilePath("C:\Users\richi\omen_richiebao\omen_github\parameterize_archi_la_design_and_data_analysis\data\CHN_Shaanxi.Xian.570360_CSWD.epw")
importepw = LBImportEPW(epw_file=file_path)  # -> location, dry_bulb_temperature, dew_point_temperature, relative_humidity, wind_speed, wind_direction, direct_normal_rad, diffuse_horizontal_rad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; plug-in component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
merge = Merge(
    Data1=importepw.dry_bulb_temperature,
    Data2=importepw.dew_point_temperature,
    Data3=importepw.relative_humidity,
    Data4=importepw.wind_speed)
hourlyplot = LBHourlyPlot(data=merge)  # -> out, mesh, legend, borders, labels, title; plug-in component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
