# Grasshopper definition parae_eco_psychrometric_chart.gh (Grasshopper 1.0.7)
# plug-ins: Bifocals

file_path = FilePath("C:\Users\richi\omen_richiebao\omen_github\parameterize_archi_la_design_and_data_analysis\data\CHN_Shaanxi.Xian.570360_CSWD.epw")
importepw = LBImportEPW(epw_file=file_path)  # -> location, dry_bulb_temperature, dew_point_temperature, relative_humidity, wind_speed, wind_direction, direct_normal_rad, diffuse_horizontal_rad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; plug-in component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
analysisperiod = LBAnalysisPeriod(start_month=1, start_day=1, start_hour="8", end_hour="19")  # -> period, hoys, dates; plug-in component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
strategies = Ladybug_PassiveStrategyList({"Evaporative Cooling", "Mass + Night Vent", "Occupant Use of Fans", "Capture Internal Heat", "Passive Solar Heating"}, selected=["Evaporative Cooling", "Mass + Night Vent", "Passive Solar Heating"])
strategypar = LBPassiveStrategyParameters(balance_temp="14")  # -> strategy_par; plug-in component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
dirsolar = LBDirectionalSolarIrradiance(
    location=importepw.location,
    direct_norm=importepw.direct_normal_rad,
    diffuse_horiz=importepw.diffuse_horizontal_rad,
    srf_azimuth=Slider(180, range=0..360))  # -> report, total, direct, diff, reflect; plug-in component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
psychrometricchart = LBPsychrometricChart(
    temperature=importepw.dry_bulb_temperature,
    rel_humidity=importepw.relative_humidity,
    pressure=importepw.barometric_pressure,
    base_pt="0, 120, 0",
    period=analysisperiod.period)  # -> report, title, temp_lines, rh_lines, hr_lines, enth_wb_lines, mesh, legend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; plug-in component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
pmvpar = LBPMVComfortParameters(ppd_thresh=Slider(10, range=6..20), hr_upper=Slider(0.014, range=0.008..0.025), hr_lower=Slider(0, range=0..0.005))  # -> pmv_par; plug-in component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
pmv_polygon = LBPMVPolygon(
    psych_chart=psychrometricchart.psych_chart,
    air_speed=Slider(0.1, range=0.1..1),
    met_rate=Slider(1.1, range=0.7..2.4),
    clothing=[Slider(1, range=0.5..1), Slider(0.5, range=0.5..1)],
    pmv_par=pmvpar,
    merge_poly=Toggle(True),
    strategies=strategies,
    strategy_par=strategypar,
    solar_data=dirsolar.total)  # -> report, total_comfort, total_comf_data, polygon_names, polygon_comfort, polygon_data, comfort_poly, strategy_poly; plug-in component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
panel = Panel(pmv_polygon.polygon_comfort)
panel_2 = Panel(pmv_polygon.polygon_names)
total_thermal_comfort = Panel(pmv_polygon.total_comfort)
hourlyplot = LBHourlyPlot(data=pmv_polygon.total_comf_data)  # -> report, mesh, legend, borders, labels, title; plug-in component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
