# Grasshopper definition parae_eco_windrose.gh (Grasshopper 1.0.7)
# plug-ins: Bifocals

file_path = FilePath("C:\Users\richi\omen_richiebao\omen_github\parameterize_archi_la_design_and_data_analysis\data\CHN_Shaanxi.Xian.570360_CSWD.epw")
importepw = LBImportEPW(epw_file=file_path)  # -> location, dry_bulb_temperature, dew_point_temperature, relative_humidity, wind_speed, wind_direction, direct_normal_rad, diffuse_horizontal_rad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; plug-in component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
windrose = LBWindRose(
    data=[importepw.wind_speed, importepw.dry_bulb_temperature],
    wind_direction=importepw.wind_direction,
    freq_hours="100",
    statement="0 <= a < 25 and 10 < b < 25")  # -> report, mesh, compass, orient_line, freq_line, windrose_line, legend, title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; plug-in component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
bang = ExplodeTree(Data=graft(windrose.histogram))  # -> Branch0, Branch1
xmatrix = LBDeconstructMatrix(matrix=bang.Branch0)  # -> values; plug-in component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
xmatrix_2 = LBDeconstructMatrix(matrix=bang.Branch1)  # -> values; plug-in component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
orientations_degrees = Panel(windrose.angles)
avr = Average(Input=xmatrix)  # -> flatten(ArithmeticMean)
lng = ListLength(List=xmatrix_2)  # -> flatten(Length)
frequency_per_direction_hours = Panel(lng)
average_values_per_direction_m_s = Panel(avr)
