# Grasshopper definition parae_highpoint.gh (Grasshopper 1.0.7)
# plug-ins: Bifocals, Kangaroo2 Components

# Created on Tue Sep 21 00:10:03 202120212021@author: Richie Bao-parameterize_archi_la_design_and_data_analysis 西安建筑科技大学-规划/建筑/景观本科数字化系列课程
number_slider = Slider(4.16, range=0..100)
number_slider_2 = Slider(150, range=0..300)
number_slider_3 = Slider(6, range=0..100)
point = Point(Point(103.0795231, 147.8575802, 0))
radial = Radial(Plane=point, Size=number_slider, ExtentR=Slider(26, range=0..100), ExtentP=number_slider_2)  # -> Cells, Points
unit_z = UnitZ(Factor=Slider(63.47, range=0..800))
integer_division = IntegerDivision(A=number_slider_2, B=number_slider_3)
addition = Addition(A=number_slider_3, B="1")
flip_matrix = FlipMatrix(Data=radial.Points)
list_item = ListItem(List=reverse(flip_matrix), Index="0", Wrap=True)  # -> flatten(Item)
list_item_2 = ListItem(List=flip_matrix, Index="0", Wrap=True)
move = Move(Geometry=list_item_2, Motion=unit_z)  # -> Geometry, Transform
series = Series(Start="0", Step=integer_division, Count=addition)
list_item_3 = ListItem(List=list_item, Index=series, Wrap=True)
merge = Merge(Data1=list_item_3, Data2=move.Geometry)  # -> flatten(Result)
replace_items = ReplaceItems(List=flip_matrix, Item=move.Geometry, Indices="0", Wrap=False)
flip_matrix_2 = FlipMatrix(Data=replace_items)  # -> simplify(Data)
anchor = Anchor(Point=merge, Strength=10000)
list_item_4 = ListItem(List=flip_matrix_2, Index="0", Wrap=True)
insert_items = InsertItems(List=reverse(flip_matrix_2), Item=list_item_4, Indices="0", Wrap=True)  # -> reverse(List)
python_grouperaccylinder_mtl = PythonScript(TreeData=insert_items)  # -> out, simplify(PLst); inputs TreeData: tree of GeometryBase
# ---------- python_grouperaccylinder_mtl: Python ----------
import Rhino
import rhinoscriptsyntax as rs
from Grasshopper import DataTree
from Grasshopper.Kernel.Data import GH_Path
data=TreeData
branches=data.Branches
PT=DataTree[Rhino.Geometry.GeometryBase]()
def grouper(branches,dt):
    for m in range(len(branches)-1):
        a=branches[m]
        b=branches[m+1]
        for i in range(len(a)-1):
            lst=[]
            lst.append(b[i])
            lst.append(a[i])
            lst.append(b[i+1])
            lst.append(a[i+1])
            dt.AddRange(lst,GH_Path(m,i))
    return dt
PLst=grouper(branches,PT)
# ---------- end python_grouperaccylinder_mtl ----------
mesh_quad = MeshQuad(CornerA="0", CornerB="1", CornerC="3", CornerD="2")
construct_mesh = ConstructMesh(Vertices=python_grouperaccylinder_mtl.PLst, Faces=mesh_quad)
mesh_join = MeshJoin(Meshes=flatten(construct_mesh))
edgelengths = EdgeLengths(Mesh=mesh_join, LengthFactor=Slider(0.484, range=0..1), Strength=Slider(0.831, range=0..1))
show = Show(G=mesh_join)
entwine = Entwine(Branch00=edgelengths, Branch01=anchor, Branch02=show, FlattenInputs=True)
timer = Timer(Interval=20, TimerInterval=20, Target=stepsolver)  # disabled
stepsolver = StepSolver(
    GoalObjects=entwine,
    Tolerance=0.01,
    Momentum=Toggle(True),
    Damping=Slider(0.892, range=0..1),
    SubIterations=10,
    Animate=Toggle(True))  # -> I, V, O
