# Grasshopper definition parae_saddle.gh (Grasshopper 1.0.7)
# plug-ins: Bifocals, Kangaroo2 Components

# Created on Mon Sep 20 23:32:07 2021@author: Richie Bao-parameterize_archi_la_design_and_data_analysis 西安建筑科技大学-规划/建筑/景观本科数字化系列课程
number_slider = Slider(18, range=0..30)
point = Point(Point(42.14804546, 41.7565128, 12.05309042))
number_slider_2 = Slider(11.42, range=0..30)
negative = Negative(Value=number_slider_2)
construct_domain = ConstructDomain(DomainStart=number_slider_2, DomainEnd=negative)
rectangle = Rectangle(Plane=point, XSize=construct_domain, YSize=construct_domain, Radius=0)  # -> Rectangle, Length
mesh_plane = MeshPlane(Boundary=rectangle.Rectangle, WidthCount=number_slider, HeightCount=number_slider)  # -> Mesh, Area
project = Project(Geometry=point, Plane=PlaneXY(0, 0, 0))  # -> Geometry, Transform
meshcorners = MeshCorners(Mesh=mesh_plane.Mesh, Angle=2.35619449)
project_2 = Project(Geometry=meshcorners, Plane=PlaneXY(0, 0, 0))  # -> Geometry, Transform
vector_2pt = Vector2Pt(PointA=project.Geometry, PointB=project_2.Geometry, Unitize=Toggle(True))  # -> Vector, Length
point_list = PointList(Points=project_2.Geometry, Size=Slider(2.061, range=0..20))
panel = Panel("""0
2""")
amplitude = Amplitude(Vector=vector_2pt.Vector, Amplitude=Slider(5.85, range=0..20))
list_item = ListItem(List=vector_2pt.Vector, Index=panel, Wrap=True)
move = Move(Geometry=project_2.Geometry, Motion=amplitude)  # -> Geometry, Transform
amplitude_2 = Amplitude(Vector=list_item, Amplitude=Slider(3.505, range=0..20))
reverse = Reverse(Vector=amplitude_2)
list_item_2 = ListItem(List=project_2.Geometry, Index=panel, Wrap=True)
line = Line(StartPoint=meshcorners, EndPoint=move.Geometry)
move_2 = Move(Geometry=list_item_2, Motion=reverse)  # -> Geometry, Transform
list_item_3 = ListItem(List=meshcorners, Index=panel, Wrap=True)
line_2 = Line(StartPoint=list_item_3, EndPoint=move_2.Geometry)
length = Length(Curve=line_2)
length_2 = Length(Curve=line)
merge = Merge(Data1=move.Geometry, Data2=move_2.Geometry)  # -> flatten(Result)
multiplication = Multiplication(A=length, B=Slider(0.974, range=0..1))
multiplication_2 = Multiplication(A=length_2, B=Slider(0.858, range=0..1))
dot_display = DotDisplay(Point=merge, Colour=RGB(0, 0, 0), Size=Slider(0.552, range=0..1))
edgelengths = EdgeLengths(Mesh=mesh_plane.Mesh, LengthFactor=Slider(0.725, range=0..1), Strength=Slider(0.586, range=0..1))
length_line = LengthLine(Line=line, Length=multiplication_2, Strength=Slider(4.61, range=0..50))
length_line_2 = LengthLine(Line=line_2, Length=multiplication, Strength=Slider(6.15, range=0..50))
anchor = Anchor(Point=merge, Strength=10000)
show = Show(G=mesh_plane.Mesh)
entwine = Entwine(Branch00=edgelengths, Branch01=length_line, Branch02=length_line_2, Branch03=anchor, Branch04=show, FlattenInputs=True)
tree_statistics = TreeStatistics(Tree=entwine)  # -> Paths, Length, Count
timer = Timer(Interval=20, TimerInterval=20, Target=stepsolver)  # disabled
stepsolver = StepSolver(
    GoalObjects=entwine,
    Tolerance=0.01,
    Momentum=Toggle(True),
    Damping=Slider(0.456, range=0..1),
    SubIterations=10,
    Animate=Toggle(True))  # -> I, V, O
partition_list = PartitionList(List=stepsolver.O, Size=tree_statistics.Length)
number_slider_3 = Slider(0.138, range=0..1)
tree_statistics_2 = TreeStatistics(Tree=partition_list)  # -> Paths, Length, Count
list_item_4 = ListItem(List=tree_statistics_2.Paths, Index=Slider(2, range=0..5), Wrap=True)
panel_2 = Panel("""0
0.5
1""")
tree_branch = TreeBranch(Tree=partition_list, Path=list_item_4, MaintainPaths=True)
merge_2 = Merge(Data1=number_slider_3, Data2=Slider(0.554, range=0..1), Data3=number_slider_3)
perp_frame = PerpFrame(Curve=graft(tree_branch), Parameter=panel_2)
circle = Circle(Plane=perp_frame, Radius=merge_2)
loft = Loft(Curves=circle, Options={Adjust=False, Closed=False, LoftEnds=0, LoftSimp=0, LoftType=0, Rebuild=10, Refit=0.01})
cap_holes = CapHoles(Brep=loft)
