# Grasshopper definition parae_simple road amd isovist.gh (Grasshopper 1.0.7)
# Copyright: caDesign设计
# plug-ins: Bifocals

geometry_pipeline = GeometryPipeline(
    GroupByLayer=False,
    GroupByType=False,
    IncludeHidden=True,
    IncludeLocked=True,
    LayerFilter="RoadAixs9",
    NameFilter="*",
    SublayerFiltering=False,
    TypeFilter=4)
geometry_pipeline_2 = GeometryPipeline(
    GroupByLayer=False,
    GroupByType=False,
    IncludeHidden=True,
    IncludeLocked=True,
    LayerFilter="RoadAixs4",
    NameFilter="*",
    SublayerFiltering=False,
    TypeFilter=4)
# Created on Thu Sep 16 09:12:10 2021 @author: Richie Bao-parameterize_archi_la_design_and_data_analysis 西安建筑科技大学-规划/建筑/景观本科数字化系列课程
geometry_pipeline_3 = GeometryPipeline(
    GroupByLayer=False,
    GroupByType=False,
    IncludeHidden=True,
    IncludeLocked=True,
    LayerFilter="RoadAixs2",
    NameFilter="*",
    SublayerFiltering=False,
    TypeFilter=4)
panel = Panel("""2
4
9""")
entwine = Entwine(Branch00=geometry_pipeline_3, Branch01=geometry_pipeline_2, Branch02=geometry_pipeline, FlattenInputs=True)
道路快速绘制 = 道路快速绘制(道路类型=entwine, 道路圆角=Slider(1.787, range=0..4), 道路线形优化=Slider(1.818, range=0..4), 道路宽度=panel)  # -> 道路面, 道路轴线
point = Point(Point(447619.6073, 4428505.994, 0))
brep_edges = BrepEdges(Brep=道路快速绘制.道路面)  # -> Naked, Interior, NonManifold
isovist = IsoVist(Plane=point, Count=Slider(89, range=0..100), Radius=100, Obstacles=brep_edges.Naked)  # -> Points, Distance, Index
line = Line(StartPoint=point, EndPoint=isovist.Points)

# ==== cluster 道路快速绘制
道路类型 = ClusterInput()
道路线形优化 = ClusterInput()
道路宽度 = ClusterInput()
tree_statistics = TreeStatistics(Tree=道路类型)  # -> Paths, Length, Count
fit_curve = FitCurve(Curve=道路类型, Tolerance=道路线形优化)  # -> graft(Curve)
boolean_toggle = BooleanToggle(True)

division = Division(A=道路宽度, B="2")
graft_tree = GraftTree(Tree=division, IncludeEmptyLists=True, IncludeNullItems=True)
negative = Negative(Value=graft_tree)
merge = Merge(Data1=graft_tree, Data2=negative)
tree_statistics_2 = TreeStatistics(Tree=merge)  # -> Paths, Length, Count
stack_data = StackData(Data=tree_statistics_2.Paths, Stack=tree_statistics.Length)
tree_branch = TreeBranch(Tree=merge, Path=stack_data, MaintainPaths=True)
partition_list = PartitionList(List=tree_branch, Size="2")

clean_tree = CleanTree(Tree=fit_curve, CleanInvalid=boolean_toggle, CleanEmpty=boolean_toggle)
offset = Offset(Curve=clean_tree, Distance=partition_list, Plane=PlaneXY(0, 0, 0), Corners=1)  # -> simplify(Curve)
shift_paths = ShiftPaths(Data=offset, Offset=-1)
end_points = EndPoints(Curve=shift_paths)  # -> Start, End
polyline = PolyLine(Vertices=end_points.End, Closed=False)
polyline_2 = PolyLine(Vertices=end_points.Start, Closed=False)
reverse_list = ReverseList(List=shift_paths)
list_item = ListItem(List=shift_paths, Index=0, Wrap=True)
list_item_2 = ListItem(List=reverse_list, Index=0, Wrap=True)
merge_2 = Merge(Data1=shift_paths, Data2=polyline_2, Data3=polyline)
boundary_surfaces = BoundarySurfaces(Edges=merge_2)  # -> flatten(Surfaces)
tween_curve = TweenCurve(CurveA=list_item, CurveB=list_item_2, Factor=0.5, BlendType=0)
solid_union = SolidUnion(Breps=boundary_surfaces)
道路轴线 = ClusterOutput(tween_curve)
brep_edges = BrepEdges(Brep=solid_union)  # -> Naked, Interior, NonManifold
join_curves = JoinCurves(Curves=brep_edges.Naked, Preserve=False)
道路圆角 = ClusterInput()
fillet = Fillet(Curve=join_curves, Radius=道路圆角)
boundary_surfaces_2 = BoundarySurfaces(Edges=fillet)
道路面 = ClusterOutput(boundary_surfaces_2)
