# Grasshopper definition parae_wave.gh (Grasshopper 1.0.7)
# plug-ins: Bifocals, Kangaroo2 Components

# Created on Mon Sep 20 23:45:16 20212021@author: Richie Bao-parameterize_archi_la_design_and_data_analysis 西安建筑科技大学-规划/建筑/景观本科数字化系列课程
point = Point([Point(-22.80891383, -188.0556209, 0), Point(-22.80891383, -119.3478108, 0)])
unit_z = UnitZ(Factor=Slider(29.252, range=0..90))
move = Move(Geometry=point, Motion=unit_z)  # -> Geometry, Transform
unit_z_2 = UnitZ(Factor=1)
number_slider = Slider(2, range=0..30)
polyline = PolyLine(Vertices=move.Geometry, Closed=False)
unit_vector = UnitVector(Vector=polyline)
cross_product = CrossProduct(VectorA=unit_vector, VectorB=unit_z_2, Unitize=Toggle(True))  # -> Vector, Length
divide_length = DivideLength(Curve=polyline, Length=number_slider)  # -> Points, Tangents, Parameters
series = Series(Start="0", Step=number_slider, Count=Slider(101, range=0..700))  # -> graft(Series)
amplitude = Amplitude(Vector=cross_product.Vector, Amplitude=series)
move_2 = Move(Geometry=divide_length.Points, Motion=amplitude)  # -> Geometry, Transform
tree_statistics = TreeStatistics(Tree=move_2.Geometry)  # -> Paths, Length, Count
python_grouperaccylinder_mtl = PythonScript(TreeData=move_2.Geometry)  # -> out, simplify(PLst); inputs TreeData: tree of GeometryBase
# ---------- python_grouperaccylinder_mtl: Python ----------
import Rhino
import rhinoscriptsyntax as rs
from Grasshopper import DataTree
from Grasshopper.Kernel.Data import GH_Path
data=TreeData
branches=data.Branches
PT=DataTree[Rhino.Geometry.GeometryBase]()
def grouper(branches,dt):
    for m in range(len(branches)-1):
        a=branches[m]
        b=branches[m+1]
        for i in range(len(a)-1):
            lst=[]
            lst.append(b[i])
            lst.append(a[i])
            lst.append(b[i+1])
            lst.append(a[i+1])
            dt.AddRange(lst,GH_Path(m,i))
    return dt
PLst=grouper(branches,PT)
# ---------- end python_grouperaccylinder_mtl ----------
mesh_quad = MeshQuad(CornerA="0", CornerB="1", CornerC="3", CornerD="2")
duplicate_data = DuplicateData(Data="0", Number=Slider(9, range=0..20), Order=True)
construct_mesh = ConstructMesh(Vertices=python_grouperaccylinder_mtl.PLst, Faces=mesh_quad)
merge = Merge(Data1="1", Data2=duplicate_data)  # -> flatten(Result)
cull_pattern = CullPattern(List=tree_statistics.Paths, CullPattern=merge)
tree_branch = TreeBranch(Tree=move_2.Geometry, Path=cull_pattern, MaintainPaths=True)
edgelengths = EdgeLengths(Mesh=construct_mesh, LengthFactor=Slider(0.726, range=0..1), Strength=Slider(0.654, range=0..1))
panel = Panel("""0
1""")
show = Show(G=construct_mesh)
tree_statistics_2 = TreeStatistics(Tree=tree_branch)  # -> Paths, Length, Count
dispatch = Dispatch(List=tree_statistics_2.Paths, DispatchPattern=panel)  # -> ListA, ListB
tree_branch_2 = TreeBranch(Tree=tree_branch, Path=dispatch.ListA, MaintainPaths=True)
tree_branch_3 = TreeBranch(Tree=tree_branch, Path=dispatch.ListB, MaintainPaths=True)
list_item = ListItem(List=reverse(tree_branch_2), Index="0", Wrap=True)
list_item_2 = ListItem(List=tree_branch_2, Index="0", Wrap=True)
list_item_3 = ListItem(List=tree_branch_3, Index="0", Wrap=True)
list_item_4 = ListItem(List=reverse(tree_branch_3), Index="0", Wrap=True)
merge_2 = Merge(Data1=list_item_2, Data2=list_item)
merge_3 = Merge(Data1=list_item_3, Data2=list_item_4)
polyline_2 = PolyLine(Vertices=merge_3, Closed=False)
point_2 = Point(merge_3)
merge_4 = Merge(Data1=merge_2, Data2=point_2)
length_line = LengthLine(Line=polyline_2, Strength=10)
xy_plane = XYPlane(Origin=Point(0, 0, 0))
boolean_toggle = BooleanToggle(False)
project = Project(Geometry=merge_4, Plane=xy_plane)  # -> Geometry, Transform
project_2 = Project(Geometry=point_2, Plane=xy_plane)  # -> Geometry, Transform
polyline_3 = PolyLine(Vertices=project.Geometry, Closed=False)
polyline_4 = PolyLine(Vertices=project_2.Geometry, Closed=False)
anchorxyz = AnchorXYZ(Point=merge_4, X=Toggle(True), Y=boolean_toggle, Z=boolean_toggle, Strength=1000)
unit_vector_2 = UnitVector(Vector=polyline_4)
unit_vector_3 = UnitVector(Vector=polyline_3)
amplitude_2 = Amplitude(Vector=unit_vector_3, Amplitude=Slider(30, range=0..30))
amplitude_3 = Amplitude(Vector=unit_vector_2, Amplitude=Slider(8.132, range=0..30))
reverse = Reverse(Vector=amplitude_2)
reverse_2 = Reverse(Vector=amplitude_3)
merge_5 = Merge(Data1=reverse, Data2=amplitude_2)
merge_6 = Merge(Data1=amplitude_3, Data2=reverse_2)
move_3 = Move(Geometry=project.Geometry, Motion=merge_5)  # -> Geometry, Transform
line = Line(StartPoint=merge_4, EndPoint=move_3.Geometry)
move_4 = Move(Geometry=project_2.Geometry, Motion=merge_6)  # -> Geometry, Transform
line_2 = Line(StartPoint=point_2, EndPoint=move_4.Geometry)
tree_statistics_3 = TreeStatistics(Tree=line)  # -> Paths, Length, Count
panel_2 = Panel("""0
1""")
merge_7 = Merge(Data1=move_3.Geometry, Data2=move_4.Geometry)  # -> flatten(Result)
dispatch_2 = Dispatch(List=tree_statistics_3.Paths, DispatchPattern=panel_2)  # -> ListA, ListB
show_2 = Show(G=line_2)
tree_branch_4 = TreeBranch(Tree=line, Path=dispatch_2.ListA, MaintainPaths=True)
tree_branch_5 = TreeBranch(Tree=line, Path=dispatch_2.ListB, MaintainPaths=True)
length = Length(Curve=tree_branch_4)
length_line_2 = LengthLine(Line=line_2, Strength=10)
anchor = Anchor(Point=merge_7, Strength=10000)
length_line_3 = LengthLine(Line=tree_branch_5, Strength=10)
multiplication = Multiplication(A=length, B=Slider(0.244, range=0..1))
length_line_4 = LengthLine(Line=tree_branch_4, Length=multiplication, Strength=10)
entwine = Entwine(
    Branch00=show,
    Branch01=edgelengths,
    Branch02=length_line,
    Branch03=length_line_3,
    Branch04=length_line_4,
    Branch05=anchorxyz,
    Branch06=show_2,
    Branch07=length_line_2,
    Branch08=anchor,
    FlattenInputs=True)
timer = Timer(Interval=20, TimerInterval=20, Target=stepsolver)  # disabled
tree_statistics_4 = TreeStatistics(Tree=entwine)  # -> Paths, Length, Count
stepsolver = StepSolver(
    GoalObjects=entwine,
    Tolerance=0.01,
    Momentum=Toggle(True),
    Damping=Slider(0.53, range=0..1),
    SubIterations=10,
    Animate=Toggle(True))  # -> I, V, O
partition_list = PartitionList(List=stepsolver.O, Size=tree_statistics_4.Length)
number_slider_2 = Slider(0.138, range=0..1)
tree_statistics_5 = TreeStatistics(Tree=partition_list)  # -> Paths, Length, Count
merge_8 = Merge(Data1=number_slider_2, Data2=Slider(0.554, range=0..1), Data3=number_slider_2)
panel_3 = Panel("""0
0.5
1""")
list_item_5 = ListItem(List=tree_statistics_5.Paths, Index=Slider(7, range=0..10), Wrap=True)
tree_branch_6 = TreeBranch(Tree=partition_list, Path=list_item_5, MaintainPaths=True)
perp_frame = PerpFrame(Curve=graft(tree_branch_6), Parameter=panel_3)
circle = Circle(Plane=perp_frame, Radius=merge_8)
loft = Loft(Curves=circle, Options={Adjust=False, Closed=False, LoftEnds=0, LoftSimp=0, LoftType=0, Rebuild=10, Refit=0.01})
cap_holes = CapHoles(Brep=loft)
